# Grasshopper definition Puzzle.gh (Grasshopper 1.0.7)

crv = Curve(<curve referenced from the Rhino model>)
bbox = BoundingBox(Content=crv, Plane=PlaneXY(0, 0, 0))  # -> Box, Box_2
number_slider = Slider(8, range=0..10)
area = Area(Geometry=bbox.Box)  # -> Area, Centroid
scale = Scale(Geometry=bbox.Box, Center=area.Centroid, Factor=Slider(1, range=0..10))  # -> Geometry, Transform
sdivide = DivideSurface(Surface=scale.Geometry, UCount=number_slider, VCount=number_slider)  # -> simplify(Points), Normals, Parameters
relitem = RelativeItem(Tree=sdivide.Points, Offset="{0}(+1)", WrapPaths=False, WrapItems=False)  # -> ItemA, ItemB
relitem_2 = RelativeItem(Tree=sdivide.Points, Offset="{+1}(0)", WrapPaths=False, WrapItems=False)  # -> ItemA, ItemB
ln = Line(StartPoint=relitem.ItemA, EndPoint=relitem.ItemB)
ln_2 = Line(StartPoint=relitem_2.ItemA, EndPoint=relitem_2.ItemB)
eval = EvaluateCurve(Curve=simplify(flatten([ln, ln_2])), Parameter=graft(".5"))  # -> Point, Tangent, Angle
len = Length(Curve=ln)
align = AlignPlane(Plane=eval.Point, Direction=eval.Tangent)  # -> Plane, Angle
crv_2 = Curve([<curve referenced from the Rhino model> x2])
division = Division(A=len, B="10")
panel = Panel(division)
scale_2 = Scale(Geometry=crv_2, Center=Point(0, 0, 0), Factor=division)  # -> Geometry, Transform
orient = Orient(Geometry=scale_2.Geometry, Source=PlaneXY(0, 0, 0), Target=align.Plane)  # -> Geometry, Transform
reduce = RandomReduce(List=orient.Geometry, Reduction=Slider(42, range=0..100), Seed=1)
srfsplit = SurfaceSplit(Surface=scale.Geometry, Curves=flatten(reduce))
item = ListItem(List=srfsplit, Index=Slider(35, range=0..100), Wrap=True)
