# Grasshopper definition nest.gh (Grasshopper 1.0.7)
# plug-ins: EleFront

number_slider = Slider(0.33, range=0..1)  # disabled
number_slider_2 = Slider(0.72, range=0..1)  # disabled
genes = GenePool(Decimals=0, Maximum=360, Minimum=0, Value=[299, 280, 86])
genes_2 = GenePool(Decimals=2, Maximum=1, Minimum=0, Value=[0.26, 0.84, 0.5])
genes_3 = GenePool(Decimals=2, Maximum=1, Minimum=0, Value=[0.9, 0.63, 0.61])
number_slider_3 = Slider(6, range=0..16, expression="x*45/2")  # disabled
panel = Panel("""Pinza 1
Pinza 2
Pinza 3""")  # disabled
number_slider_4 = Slider(1, range=0..1)  # disabled
panel_2 = Panel("""Pinza 1
Pinza 2
Pinza 3""")
bordo = Curve(<curve referenced from the Rhino model>)  # disabled
fori = Curve(<curve referenced from the Rhino model>)  # disabled
number_slider_5 = Slider(1, range=0..4)
vec = VectorXYZ(XComponent=number_slider_2, YComponent=number_slider, ZComponent=0)  # -> Vector, Length; disabled
item = ListItem(List=panel, Index=number_slider_4, Wrap=True)  # disabled
srf = Surface([<surface referenced from the Rhino model> x3])
short = ShortestList(ListSurf=srf, ListX=genes_3, ListAngolo=genes, ListY=genes_2, TrimMode=2)  # -> ListSurf, ListX, ListAngolo, ListY
evalsrf = EvaluateSurface(Surface=reparameterize(bordo), Point=vec.Vector)  # -> Point, Normal, UDirection, VDirection, Frame; disabled
vec_2 = VectorXYZ(XComponent=short.ListX, YComponent=short.ListY, ZComponent=0)  # -> Vector, Length
item_2 = ListItem(List=panel_2, Index=number_slider_5, Wrap=True)
evalsrf_2 = EvaluateSurface(Surface=reparameterize(srf), Point=vec_2.Vector)  # -> Point, Normal, UDirection, VDirection, Frame
pl_origin = PlaneOrigin(Base=evalsrf.Point, Origin=evalsrf.Point)  # disabled
srf_cp = SurfaceClosestPoint(Point=evalsrf_2.Point, Surface=srf)  # -> Point, UVPoint, Distance
xy = XYPlane(Origin=evalsrf_2.Point)
rotate = Rotate(Geometry=pl_origin, Angle=degrees(number_slider_3), Plane=evalsrf.Point)  # -> Geometry, Transform; disabled
rotate_2 = Rotate(Geometry=xy, Angle=degrees(short.ListAngolo), Plane=xy)  # -> Geometry, Transform
inblock = InsertBlock(BlockName=item, SourcePlane=rotate.Geometry)  # disabled
inblock_2 = InsertBlock(BlockName=item_2, SourcePlane=rotate_2.Geometry)
deblock = DeconstructBlock(Block=inblock)  # -> Name, Plane, flatten(Geometry); disabled
debrep = DeconstructBrep(Brep=srf)  # -> Faces, Edges, Vertices
deblock_2 = DeconstructBlock(Block=inblock_2)  # -> Name, Plane, Geometry
area = Area(Geometry=flatten(deblock.Geometry))  # -> Area, Centroid; disabled
join = JoinCurves(Curves=debrep.Edges, Preserve=False)
ccx = CurveCurve(CurveA=deblock.Geometry, CurveB=graft(fori))  # -> flatten(Points), ParamsA, ParamsB; disabled
split = SplitList(List=reverse(join), Index=1)  # -> ListA, ListB
ccx_2 = CurveCurve(CurveA=deblock.Geometry, CurveB=graft(bordo))  # -> flatten(Points), ParamsA, ParamsB; disabled
incurves = PointInCurves(Point=area.Centroid, Curves=bordo)  # -> Relationship, Index, Point; disabled
incurves_2 = PointInCurves(Point=area.Centroid, Curves=fori)  # -> Relationship, Index, Point; disabled
area_2 = Area(Geometry=deblock_2.Geometry)  # -> flatten(Area), Centroid
rdiff = RegionDifference(CurvesA=split.ListA, CurvesB=split.ListB)
python = GhPythonScript(PuntiBordo=incurves.Relationship, PuntiForo=incurves_2.Relationship, intersezioni=[ccx.Points, ccx_2.Points])  # -> out, value; inputs PuntiBordo: list, PuntiForo: list, intersezioni: list; disabled
# ---------- python: Python ----------
__author__ = "Stefano"
__version__ = "2019.01.09"

import rhinoscriptsyntax as rs
print PuntiBordo
calcolo = []
for i in PuntiBordo:
    i = "PtBordo"+ str(i)
    calcolo.append(i)
for i in PuntiForo:
    i = "ptForo"+ str(i)
    calcolo.append(i)
for i in intersezioni:
    calcolo.append(i)
print calcolo
value = 0
for i in calcolo:
    if rs.IsPoint(i):
        value  = value + 20
        print "non valido"
    if i =="ptForo2":
        value  = value + 50
        print "non valido"
    if i == "PtBordo0":
        value  = value + 100
        print "non valido"
# ---------- end python ----------
rint = RegionIntersection(CurvesA=flatten(deblock_2.Geometry), CurvesB=graft(rdiff))
area_3 = Area(Geometry=rint)  # -> flatten(Area), Centroid
ma = MassAddition(Input=area_2.Area)  # -> Result, PartialResults
ma_2 = MassAddition(Input=area_3.Area)  # -> Result, PartialResults
addition = Addition(A=python.value, B=0)  # disabled
subtraction = Subtraction(A=ma.Result, B=ma_2.Result)
galapagos = Galapagos(fitness=subtraction, gene=[genes_2, genes, genes_3, number_slider_5])
data = Data(addition)  # disabled
panel_3 = Panel(data)  # disabled
panel_4 = Panel(subtraction)
galapagos_2 = Galapagos(fitness=data, gene=[number_slider, number_slider_2, number_slider_3, number_slider_4])
