# Grasshopper definition visualpinza.gh (Grasshopper 1.0.7)
# plug-ins: EleFront

pipeline = GeometryPipeline(
    GroupByLayer=False,
    GroupByType=False,
    IncludeHidden=True,
    IncludeLocked=True,
    LayerFilter="*",
    NameFilter="*",
    SublayerFiltering=True,
    TypeFilter=4)
panel = Panel("""black
red
blue""")
filtercolor = FilterByColor(Geometry=pipeline, Color=panel)
dima = Slider(0, range=0..10)
pinza = Slider(0, range=0..10)
bang = ExplodeTree(Data=filtercolor)  # -> Branch0, Branch1, Branch2
listblockd = ListBlockDocument()
bordo = Surface(bang.Branch0)
foro = Curve(bang.Branch2)
crv = Curve(bang.Branch1)
item = ListItem(List=listblockd, Index=pinza, Wrap=True)
item_2 = ListItem(List=bordo, Index=dima, Wrap=True)
inblock = InsertBlock(BlockName=item, SourcePlane=PlaneXY(0, 0, 0))
srfsplit = SurfaceSplit(Surface=item_2, Curves=flatten([foro, crv]))
area = Area(Geometry=srfsplit)  # -> Area, Centroid
panel_2 = Panel(srfsplit)
sort = SortList(Keys=area.Area, ValuesA=srfsplit)  # -> Keys, ValuesA
item_3 = ListItem(List=reverse(sort.ValuesA), Index=0, Wrap=True)
edges = BrepEdges(Brep=item_3)  # -> Naked, Interior, NonManifold
Y = UnitY(Factor=1)
popgeo = PopulateGeometry(Geometry=item_3, Count=Slider(100, range=0..100), Seed=1)
line = LineSDL(Start=popgeo, Direction=Y, Length="200")
join = JoinCurves(Curves=flatten(edges.Naked), Preserve=False)
range = Range(Domain="0 to 360", Steps=Slider(10, range=0..100))
len = Length(Curve=join)
rotate = Rotate(Geometry=line, Angle=graft(degrees(range)), Plane=popgeo)  # -> flatten(Geometry), Transform
sort_2 = SortList(Keys=len, ValuesA=join)  # -> Keys, reverse(ValuesA)
trim = TrimWithRegions(Curve=rotate.Geometry, Regions=foro)  # -> Inside, Outside
crv_2 = Curve(trim.Outside)
trim_2 = TrimWithRegions(Curve=crv_2, Regions=sort_2.ValuesA)  # -> Inside, Outside
crv_3 = Curve(trim_2.Inside)
len_2 = Length(Curve=crv_3)
larger = LargerThan(FirstNumber=len_2, SecondNumber=Slider(19, range=0..100))  # -> LargerThan, OrEqualTo
dispatch = Dispatch(List=crv_3, DispatchPattern=larger.LargerThan)  # -> ListA, ListB
crv_4 = Curve(dispatch.ListA)
eval = EvaluateCurve(Curve=reparameterize(crv_4), Parameter="0")  # -> Point, Tangent, Angle
align = AlignPlane(Plane=eval.Point, Direction=eval.Tangent)  # -> Plane, Angle
orient = Orient(Geometry=inblock, Source=PlaneXY(0, 0, 0), Target=align.Plane)  # -> Geometry, Transform
crv_5 = Curve(join)
deblock = DeconstructBlock(Block=orient.Geometry)  # -> Name, Plane, Geometry
prune = PruneTree(Tree=deblock.Geometry, Minimum="1", Maximum=0)
ins = InsertItems(List=prune, Item=crv_5, Indices=0, Wrap=False)
mcx = MultipleCurves(Curves=ins)  # -> Points, IndexA, IndexB, ParamA, ParamB
tstat = TreeStatistics(Tree=mcx.Points)  # -> Paths, Length, Count
group = Group(Objects=prune)
equals = Equality(FirstNumber=tstat.Length, SecondNumber="0")  # -> Equality, Inequality
dispatch_2 = Dispatch(List=flatten(group), DispatchPattern=equals.Equality)  # -> ListA, ListB
grp = Group(dispatch_2.ListA)
item_4 = ListItem(List=grp, Index=0, Wrap=True)
panel_3 = Panel(grp)
